# Grasshopper definition sample.gh (Grasshopper 1.0.7)
# plug-ins: test2

selectmemberrange = SelectMemberRange(MemberType="Brace", LowerFloor="4F", UpperFloor="5F", StartFrame="X3", EndFrame="X3", StartAxis="Y2", EndAxis="Y5")
selectmemberrange_2 = SelectMemberRange(MemberType="Brace", LowerFloor="1F", UpperFloor="10F")
deletemember = DeleteMember(DesignCode="e1", Description="e1", Target=selectmemberrange_2)
editmember = EditMember(DesignCode="e2", Description="e2", Target=selectmemberrange, HowtoChange="OD1")
value_list = ValueList({"VelocityDependentDamperCapacity", "HysteresisDamperCapacity", "DamperRatio"}, selected="VelocityDependentDamperCapacity")
mergeplan = MergePlan(DesignCode="e3", Description="e3", Plan1=deletemember, Plan2=editmember)
panel = Panel("部材編集・削除実施例")
value_list_2 = ValueList({"X direction": "X", "Y direction": "Y"}, selected="X direction")
panel_2 = Panel("パラスタ実施例")
damperdesignalgorithm = DamperDesignAlgorithm(
    Target=selectmemberrange_2,
    Strategy=value_list,
    Direction=value_list_2,
    UpperLimit=Slider(1, range=0..1),
    LowerLimit=Slider(0.1, range=0..1),
    Interval=Slider(0.1, range=0..1))
file_path = FilePath("E:\日建提案\paraparaRESP\test2\bin\ChangeDampMark\")
file_path_2 = FilePath("E:\日建提案\paraparaRESP\test2\bin\para_base.dz")
run_resp_d_script = RunRESPDScript(Plan=flatten(damperdesignalgorithm), OutputDirectory=file_path, DzFileName=file_path_2)
