# Grasshopper definition sample_file.gh (Grasshopper 1.0.7)
# plug-ins: test2

selectmemberrange = SelectMemberRange(MemberType="Brace", LowerFloor="4F", UpperFloor="5F", StartFrame="X3", EndFrame="X3", StartAxis="Y2", EndAxis="Y5")
selectmemberrange_2 = SelectMemberRange(MemberType="Brace", LowerFloor="4F", UpperFloor="5F", StartFrame="X3", EndFrame="X3", StartAxis="Y2", EndAxis="Y5")
deletemember = DeleteMember(DesignCode="e1", Discription="e1", Target=selectmemberrange)
editmember = EditMember(DesignCode="e2", Discription="e2", Target=selectmemberrange_2, HowtoChange="OD1")
mergeplan = MergePlan(DesignCode="e3", Description="e3", Plan1=deletemember, Plan2=editmember)
damperdesignalgorithm = DamperDesignAlgorithm()
file_path = FilePath("E:\日建提案\paraparaRESP\test2\bin\ChangeDampMark\")
file_path_2 = FilePath("E:\日建提案\paraparaRESP\test2\bin\a01.dz")
run_resp_d_script = RunRESPDScript(Plan=mergeplan, OutputDirectory=file_path, DzFileName=file_path_2)
