# Grasshopper definition test.gh (Grasshopper 1.0.7)
# plug-ins: test2

対象構面_x_と入力してください = Panel("""X1
X4
X5""")
対象構面_y_と入力してください = Panel("""Y1
Y7
Y8
Y10""")
axis1 = Slider(2, range=1..20)
axis2 = Slider(5, range=1..20)
axis1_2 = Slider(2, range=1..20)
axis2_2 = Slider(5, range=1..20)
floor1 = Slider(1, range=1..20)
floor2 = Slider(1, range=1..20)
frame1 = Slider(3, range=1..20)
frame2 = Slider(4, range=1..20)
floor1_2 = Slider(3, range=1..20)
floor2_2 = Slider(3, range=1..20)
frame1_2 = Slider(3, range=1..20)
frame2_2 = Slider(4, range=1..20)
対象階_fと入力してください = Panel("""1F
2F
3F""")
selectrangemember = SelectRangeMember(
    MemberType="Brace",
    LowerFloor=floor1,
    UpperFloor=floor2,
    StartFrame=frame1,
    EndFrame=frame2,
    StartAxis=axis1,
    EndAxis=axis2)
selectrangemember_2 = SelectRangeMember(
    MemberType="Brace",
    LowerFloor=floor1_2,
    UpperFloor=floor2_2,
    StartFrame=frame1_2,
    EndFrame=frame2_2,
    StartAxis=axis1_2,
    EndAxis=axis2_2)
selectmember = SelectMember(MemberType="Brace", Floor=対象階_fと入力してください, Frame=対象構面_x_と入力してください, Axis=対象構面_y_と入力してください)
selectmemberrange = SelectMemberRange()
list = ValueList({"Replace OD20", "Replace OD30", "Replace OD40", "Delete"}, selected="Delete")
list_2 = ValueList({"Replace OD20", "Replace OD30", "Replace OD40", "Delete"}, selected="Delete")
list_3 = ValueList({"Replace OD20", "Replace OD30", "Replace OD40", "Delete"}, selected="Delete")
plan = Plan(DesignCode="Brace", Discription="Brace", Target=selectmember, Strategy=list)
paraarrange = ParaArrange(
    Target=selectrangemember,
    UpperLimit=Slider(100, range=0..100),
    LowerLimit=Slider(0, range=0..100),
    StepRange=Slider(1, range=1..15),
    Strategy=list_2)
paraarrange_2 = ParaArrange(
    Target=selectrangemember_2,
    UpperLimit=Slider(100, range=0..100),
    LowerLimit=Slider(0, range=0..100),
    StepRange=Slider(1, range=1..15),
    Strategy=list_3)
mergeplan = MergePlan(Plan1=paraarrange, Plan2=paraarrange_2)
path = FilePath("E:\日建提案\paraparaRESP\test2\bin\a01.dz")
path_2 = FilePath("E:\日建提案\paraparaRESP\test2\bin\ChangeDampMark\")
run_resp_d_script = RunRESPDScript(Plan=plan, OutputDirectory=path_2, DzFileName=path)
